# Grasshopper definition boxes.gh (Grasshopper 1.0.8)
# plug-ins: Raystrack

# ---- group: 1) Check if installation is ready
rs_runtime = RSRuntime(Refresh=Button())  # -> Python, Devices, Status
panel = Panel(rs_runtime.Status)

# ---- group: 2) Prepare geometry
center_box = CenterBox(Base=PlaneXY(0, 0, 0), X=1, Y=1, Z=1)
center_box_2 = CenterBox(Base="3,0,0", X=1, Y=1, Z=1)
brep = Brep(center_box)
brep_2 = Brep(center_box_2)
rs_surface = RSSurface(Geometry=brep, ID="box_1")
rs_surface_2 = RSSurface(Geometry=brep_2, ID="box_2")
rs_scene = RSScene(Surfaces=[rs_surface, rs_surface_2])  # -> Scene, IDs

center_box_3 = CenterBox(Base=PlaneXY(0, 0, 0), X=1, Y=1, Z=1)
brep_3 = Brep(center_box_3)
deconstruct_brep = DeconstructBrep(Brep=brep_3)  # -> Faces, Edges, Vertices
list_length = ListLength(List=deconstruct_brep.Faces)
series = Series(Start=0, Step=1, Count=list_length)
rs_surface_3 = RSSurface(Geometry=deconstruct_brep.Faces, ID=series)
rs_scene_2 = RSScene(Surfaces=rs_surface_3)  # -> Scene, IDs

# ---- group: 3) Query and Settings / Toggle flip to reverse normal vector
boolean_toggle = BooleanToggle(True)

# ---- group: 3) Query and Settings
rs_accuracy = RSAccuracy(MaxReplicates=100, MinReplicates=5, Tolerance=0.0001, Mode="stderr", MinRays=0)
rs_sampling = RSSampling(Density=16, Rays=128, Seed=1, Mode="fair", Strategy="cosine", PairSamples=8192, Flip=Toggle(False))
rs_sky = RSSky(Mode="merged", Center=Point(0, 0, 0), Radius=10, LabelSize=0, ShowLabels=True)  # -> Sky, Patches, Labels, LabelPoints, Tags
rs_options = RSOptions(Sampling=rs_sampling, Accuracy=rs_accuracy, BatchSize=65536, Reciprocity="none")
rs_query = RSQuery(Mode="matrix", Sky=rs_sky.Sky, Sides="both")

# ----
rs_to_brep = RSToBrep(Data=rs_scene.Scene)  # -> Breps, IDs, Labels

# ---- group: 3) Query and Settings
rs_accuracy_2 = RSAccuracy(MaxReplicates=100, MinReplicates=5, Tolerance=0.0001, Mode="stderr", MinRays=0)
rs_sampling_2 = RSSampling(Density=16, Rays=128, Seed=1, Mode="fair", Strategy="cosine", PairSamples=8192, Flip=boolean_toggle)
rs_options_2 = RSOptions(Sampling=rs_sampling_2, Accuracy=rs_accuracy_2, BatchSize=65536, Reciprocity="none")
rs_query_2 = RSQuery(Mode="matrix", Sides="back")

# ---- group: 4) Solve
rs_solve = RSSolve(
    Scene=rs_scene_2.Scene,
    Query=rs_query_2,
    Options=rs_options_2,
    Device="auto",
    Acceleration="instanced",
    RayBudget=0,
    Run=Toggle(False),
    Cancel=Button())  # -> Result, Status, Progress, Rays, Info

rs_solve_2 = RSSolve(
    Scene=rs_scene.Scene,
    Query=rs_query,
    Options=rs_options,
    Device="auto",
    Acceleration="instanced",
    RayBudget=0,
    Run=Toggle(True),
    Cancel=Button())  # -> Result, Status, Progress, Rays, Info

# ----
panel_2 = Panel(rs_solve.Status)
panel_3 = Panel(rs_solve.Info)
panel_4 = Panel(rs_solve_2.Status)
panel_5 = Panel(rs_solve_2.Info)

# ---- group: 5) View Results
rs_result_table = RSResultTable(Result=rs_solve.Result)  # -> Senders, Channels, Labels, Values, Errors, Coverage
panel_6 = Panel(rs_result_table.Labels)
panel_7 = Panel(rs_result_table.Values)
panel_8 = Panel(rs_result_table.Errors)

rs_result_table_2 = RSResultTable(Result=rs_solve_2.Result)  # -> Senders, Channels, Labels, Values, Errors, Coverage
panel_9 = Panel(rs_result_table_2.Labels)
panel_10 = Panel(rs_result_table_2.Values)
panel_11 = Panel(rs_result_table_2.Errors)
