# Grasshopper definition facing-plates.gh (Grasshopper 1.0.8)
# plug-ins: Raystrack

sampling = RSSampling(Density=64, Rays=512, Seed=1, Mode="fair", Strategy="cosine", PairSamples=8192, Flip=False)
surface = RSSurface(Geometry=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, ID="A")
instance = RSInstance(
    Surface=surface,
    ID="B",
    Transform={TransformCount=1, Name="Generic", m00=1, m01=0, m02=0, m03=0, m10=0, m11=-1, m12=0, m13=1, m20=0, m21=0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})
query = RSQuery(Mode="pair", Senders="A", Receivers="B", Sky="none", Sides="both")
accuracy = RSAccuracy(MaxReplicates=12, MinReplicates=12, Tolerance=0, Mode="stderr", MinRays=0)
scene = RSScene(Surfaces=[surface, instance])  # -> Scene, IDs
options = RSOptions(Sampling=sampling, Accuracy=accuracy, BatchSize=4096, Reciprocity="none")
solve = RSSolve(
    Scene=scene.Scene,
    Query=query,
    Options=options,
    Device="cpu",
    Acceleration="instanced",
    RayBudget=0,
    Run=False,
    Cancel=False)  # -> Result, Status, Progress, Rays, Info
value = RSResultValue(Result=solve.Result, Sender="A", Receiver="B", Kind="surface", Side="front", Patch=-1)  # -> Value, Error, Coverage
inspect = RSInspect(Data=solve.Result)
table = RSResultTable(Result=solve.Result)  # -> Senders, Channels, Labels, Values, Errors, Coverage
